# Grasshopper definition GeoOpt_mesh.gh (Grasshopper 1.0.7)
# plug-ins: Human, Hops, Kangaroo Components, OpenNest

number_slider = Slider(20, range=0..100)

close_mesh = Mesh(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)
open_tri = Data(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)

mplane = MeshPlane(
    Boundary={Plane=PlaneXY(0, 0, 0), Size=Domain2(u=-10..10, v=-10..10)},
    WidthCount=number_slider,
    HeightCount=number_slider)  # -> Mesh, Area
open_quad = Data(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)
mesh = Mesh(open_tri)
# all shortest paths
mesh_2 = Mesh(open_tri)
# minimum spanning trees
list = ValueList({"edgeLength", "sameWeight"}, selected="sameWeight")
# MaCAD22
# GeoOpt seminar
# David A. Leon and Dai Kandil
# shortest walk
mesh_3 = Mesh(open_tri)
hops = Hops(
    _Path="http://127.0.0.1:5000/meshstripper",
    Mesh=mesh_2,
    WeightMode=list,
    CacheResultsInMemory=False,
    CacheSolveResults=False,
    RemoteDefinitionLocation="http://127.0.0.1:5000/meshstripper",
    RemoteSolveVersion=(0, 1, 0),
    ShowInput_Enabled=False,
    ShowInput_Path=True,
    SynchronousSolve=True)  # -> ShortestPath, FacesIndex, Lengths
explodemesh = GhPythonScript(m=mesh)  # -> out, a; inputs m: Mesh
# ---------- explodemesh: Python ----------
import Rhino.Geometry as rg

ghenv.Component.Message = "explode mesh"

exploded = []

for i in range(m.Faces.Count):
    m_copy = m.Duplicate()
    face = m_copy.Faces.ExtractFaces([i])
    exploded.append(face)
    
a = exploded
# ---------- end explodemesh ----------
hops_2 = Hops(
    _Path="http://127.0.0.1:5000/mst",
    InputMesh=mesh,
    Weigth="1",
    CacheResultsInMemory=False,
    CacheSolveResults=False,
    RemoteDefinitionLocation="http://127.0.0.1:5000/mst",
    RemoteSolveVersion=(0, 1, 0),
    ShowInput_Enabled=False,
    ShowInput_Path=True,
    SynchronousSolve=True)  # -> ListOfFacesIndexes, Lines
explodemesh_2 = GhPythonScript(m=mesh_2)  # -> out, a; inputs m: Mesh; same code as explodemesh
python = GhPythonScript(x=hops_2.ListOfFacesIndexes)  # -> out, a
# ---------- python: Python ----------
import json
import ghpythonlib.treehelpers as th

l = th.list_to_tree(json.loads(x))

a = l
# ---------- end python ----------
partition = PartitionList(List=hops.ShortestPath, Size=hops.Lengths)
partition_2 = PartitionList(List=hops.FacesIndex, Size=hops.Lengths)
explodemesh_3 = GhPythonScript(m=mesh_3)  # -> out, a; inputs m: Mesh; same code as explodemesh

# ---- group: MESHWALKER
hops_3 = Hops(
    _Path="http://127.0.0.1:5000/meshwalker",
    Reset=Button(),
    InputMesh=mesh_3,
    FaceIndex1=Slider(35, range=0..100),
    FaceIndex2=Slider(49, range=0..100),
    CacheResultsInMemory=False,
    CacheSolveResults=False,
    RemoteDefinitionLocation="http://127.0.0.1:5000/meshwalker",
    RemoteSolveVersion=(0, 1, 0),
    ShowInput_Enabled=False,
    ShowInput_Path=True,
    SynchronousSolve=True)  # -> ListOfPoints, ListOfFacesIndexes

# ----
item = ListItem(List=explodemesh.a, Index=python.a, Wrap=True)
item_2 = ListItem(List=explodemesh_2.a, Index=partition_2, Wrap=True)
pline = PolyLine(Vertices=partition, Closed=False)
mjoin = MeshJoin(Meshes=item_2)
item_3 = ListItem(List=explodemesh_3.a, Index=hops_3.ListOfFacesIndexes, Wrap=True)

strips = Data(item)
paths = Data(hops_2.Lines)

strips_2 = Data(mjoin)
path = Data(pline)

tstat = TreeStatistics(Tree=item)  # -> Paths, Length, Count
series = Series(Start=0, Step=1, Count=tstat.Count)
tstat_2 = TreeStatistics(Tree=partition_2)  # -> Paths, Length, Count
preview = CustomPreview(
    Geometry=item_3,
    Material={diffuse=RGB(221, 160, 221), emission=RGB(66, 48, 66), shine=0.5, specular=RGB(255, 255, 255), transparency=0})
gradient = Gradient(
    LowerLimit=0,
    UpperLimit=tstat.Count,
    Parameter=series,
    stops=[0: RGB(255, 221, 0), 0.852: RGB(56, 56, 56), 1: RGB(51, 51, 51)])
series_2 = Series(Start=0, Step=1, Count=tstat_2.Count)
gradient_2 = Gradient(
    LowerLimit=0,
    UpperLimit=tstat_2.Count,
    Parameter=series_2,
    stops=[0: RGB(0, 98, 0), 0.25: RGB(81, 175, 17), 0.5: RGB(159, 198, 146), 0.75: RGB(170, 235, 41), 1: RGB(221, 255, 53)])
jitter = Jitter(List=gradient, Jitter=1, Seed=2)  # -> Values, Indices
jitter_2 = Jitter(List=gradient_2, Jitter=1, Seed=Slider(4, range=0..10))  # -> Values, Indices
preview_2 = CustomPreview(Geometry=strips_2, Material=graft(jitter_2.Values))
previewlw = CustomPreviewLineweights(Geometry=path, Shader=ColourSwatch(SwatchColor=RGB(0, 255, 187)), Thickness=3, Absolute=False)
preview_3 = CustomPreview(Geometry=strips, Material=graft(jitter.Values))
previewlw_2 = CustomPreviewLineweights(Geometry=paths, Shader=ColourSwatch(SwatchColor=RGB(0, 255, 187)), Thickness=3, Absolute=False)
unroller = Unroller(Strip=strips_2, Unroll=1)  # -> flatten(Unrolled)
face_normals = FaceNormals(Mesh=unroller)  # -> Centers, Normals
average = Average(Input=face_normals.Centers)
average_2 = Average(Input=face_normals.Normals)
plane_normal = PlaneNormal(Origin=average, ZAxis=average_2)  # -> flatten(Plane)
orient = Orient(Geometry=unroller, Source=plane_normal, Target=PlaneXY(0, 0, 0))  # -> Geometry, Transform
curve = Curve(<curve referenced from the Rhino model>)
opennest = OpenNest(
    Sheets=curve,
    Geo=orient.Geometry,
    Spacing=1,
    Placement=1,
    Tolerance=0.1,
    Rotations=4,
    Iterations=1,
    Seed=1,
    Reset=Button(),
    Run=Toggle(False))  # -> Sheets, Geo, ID, Transform, IDS
mesh_edges = MeshEdges(Mesh=opennest.Geo)  # -> NakedEdges, InteriorEdges, NonManifoldEdges
